# Grasshopper definition Path Analysis.gh (Grasshopper 1.0.8)
# plug-ins: BinaryBird, Human

# ---- group: Input
# Selects the density range factor from the list above. 0 = even density, 1 = a range that goes from 0 to 2x your target density.
density_distribution_factor = Slider(2, range=0..4)
assigning_density_order_a_to_b_matters = Panel("125 to 50 ")
gate_streep_grid = Slider(1, range=0..2)
gate_density = Slider(1, range=0..2)
density_distribution = Panel("""0.1
0.3
0.5
0.7
0.9""")
geo_street_2 = Geometry([<curve referenced from the Rhino model> x10])
geo_street_1 = Geometry([<curve referenced from the Rhino model> x3])
geo_street_3 = Geometry([<curve referenced from the Rhino model> x3])
geo_corner = Geometry([<point referenced from the Rhino model> x4])
geo_center = Geometry(<point referenced from the Rhino model>)
panel = Panel("""35
-35""")
geo_north = Geometry(<curve referenced from the Rhino model>)
geo_site = Geometry(<curve referenced from the Rhino model>)
panel_2 = Panel("8")
panel_3 = Panel("10")
panel_4 = Panel("6")

# ----
brep_high = Brep(<brep referenced from the Rhino model>)
brep_med = Brep(<brep referenced from the Rhino model>)
brep_low = Brep(<brep referenced from the Rhino model>)

# ---- group: Path Index
number_slider = Slider(69, range=0..99)

# ----
months = Panel("8")
end_hour = Panel("15")
day = Panel("1")
start_hour = Panel("13")
time_step = Panel("1")
pedestrian_path = Curve(<curve referenced from the Rhino model>)
int_start_hour = Integer(start_hour)
int_time_step = Integer(time_step)
int_end_hour = Integer(end_hour)
int_months = Integer(months)
int_day = Integer(day)
analysisperiod = LBAnalysisPeriod(
    start_month=int_months,
    start_day=int_day,
    start_hour=int_start_hour,
    end_month=int_months,
    end_day=int_day,
    end_hour=int_start_hour,
    timestep=int_time_step)  # -> period, hoys, dates; plug-in component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
path_epw_file = FilePath("C:\Users\mc5852\Studio Materials\Computational Modeling\Final Project\KOR_SO_Seoul.471080_TRY_PHIKO.epw")
divide = DivideCurve(Curve=pedestrian_path, Count=Slider(100, range=0..100), Kinks=False)  # -> Points, Tangents, Parameters
path_epw_file_2 = FilePath(path_epw_file)
path = PolyLine(Vertices=divide.Points, Closed=False)
importloc = LBImportLocation(epw_file=path_epw_file_2)  # -> location; plug-in component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
cluster = Cluster(
    num_street_width=panel,
    geo_site=geo_site,
    gate_street_grip=gate_streep_grid,
    geo_street_3=geo_street_3,
    geo_street_2=geo_street_2,
    geo_street_1=geo_street_1,
    domain_assigning_density=assigning_density_order_a_to_b_matters,
    gate_density=gate_density,
    geo_center=geo_center,
    geo_north=geo_north,
    geo_corner=geo_corner,
    num_avg_far=panel_2,
    num_high_density_far_threshold=panel_3,
    num_medium_density_far_threshold=panel_4,
    num_density_distribution=density_distribution,
    int_density_distribution_selection=density_distribution_factor)  # -> geo_blocks_4, geo_streets_3, bound_low_density, bound_medium_density, bound_high_desity, num_low_density_far_2, num_medium_density_far_2, num_high_density_far_2
cluster_2 = Cluster_2(
    bound_low_density=cluster.bound_low_density,
    bound_medium_density=cluster.bound_medium_density,
    bound_high_density=cluster.bound_high_desity,
    num_low_density_far=cluster.num_low_density_far_2,
    num_medium_density_far=cluster.num_medium_density_far_2,
    num_high_density_far=cluster.num_high_density_far_2,
    num_floor_height="18",
    brep_low=brep_low,
    brep_med=brep_med,
    brep_high=brep_high)  # -> brep_low_far_building_2, brep_medium_far_building_2, brep_high_far_building_2

# ---- group: Building Geometry
brep_medium_far_building = Brep(cluster_2.brep_medium_far_building_2)
brep_high_far_building = Brep(cluster_2.brep_high_far_building_2)
brep_low_far_building = Brep(cluster_2.brep_low_far_building_2)
ground_surface = Surface(<surface referenced from the Rhino model>)

# ----
area = Area(Geometry=ground_surface)  # -> Area, Centroid
sunpath = LBSunPath(location=importloc, hoys=analysisperiod.hoys, center_pt=area.Centroid, scale="3")  # -> report, vectors, altitudes, azimuths, hoys, sun_pts, analemma, daily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; plug-in component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

# ---- group: Urban Visualization
preview = CustomPreview(
    Geometry=[brep_low_far_building, brep_medium_far_building, brep_high_far_building],
    Material=ColourSwatch(SwatchColor=RGB(255, 207, 207)))
preview_2 = CustomPreview(Geometry=ground_surface, Material=ColourSwatch(SwatchColor=RGB(227, 227, 227)))

# ---- group: Pedestrian Path
crv_pedestrian_path = Curve(path)

# ----
building = Geometry([brep_low_far_building, brep_medium_far_building, brep_high_far_building])
building_ground = Geometry([ground_surface, brep_low_far_building, brep_medium_far_building, brep_high_far_building])

# ---- group: Simulation Main
number_slider_2 = Slider(300, range=0..1000)
panel_5 = Panel("12")
panel_6 = Panel("15")
vd = ViewDepth(
    Path=crv_pedestrian_path,
    MaxRayLength=number_slider_2,
    HorizontalViewRes=panel_5,
    VerticalViewRes=panel_6,
    Geometry=building_ground)
num_visual_depth = Number(vd)

# ----
explode = ExplodeObject(Object=building, Recursive=False)

# ---- group: Visual Field Pixel
number_slider_3 = Slider(10, range=0..10)
pt = ConstructPoint(XCoordinate=number_slider_3, YCoordinate=number_slider_3, ZCoordinate=0)
pt_2 = ConstructPoint(XCoordinate=0, YCoordinate=0, ZCoordinate=0)
series = Series(Start="-5000", Step=number_slider_3, Count=panel_6)
series_2 = Series(Start="-5000", Step=number_slider_3, Count=panel_5)
rec_2pt = Rectangle2Pt(Plane=PlaneXY(0, 0, 0), PointA=pt_2, PointB=pt, Radius=0)  # -> Rectangle, Length
pt_3 = ConstructPoint(XCoordinate=series, YCoordinate=0, ZCoordinate=0)
pt_4 = ConstructPoint(XCoordinate=0, YCoordinate=series_2, ZCoordinate=0)  # -> graft(Point)
move = Move(Geometry=rec_2pt.Rectangle, Motion=pt_3)  # -> Geometry, Transform
move_2 = Move(Geometry=move.Geometry, Motion=pt_4)  # -> flatten(Geometry), Transform
boundary = BoundarySurfaces(Edges=move_2.Geometry)
join = BrepJoin(Breps=boundary)  # -> Breps, Closed
mesh = MeshBrep(
    Brep=join.Breps,
    Settings={GridMaxCount=0, GridMinCount=16, JaggedSeams=False, MaxEdgeLength=0, MinEdgeLength=0.0001, MinTolerance=0, Refine=True, RefineAngle=0, RelativeTolerance=0.65, SimplePlanes=True, Tolerance=0})
area_2 = Area(Geometry=mesh)  # -> Area, Centroid
pt_5 = Point(Point(0, 0, 0))
vec2pt = Vector2Pt(PointA=area_2.Centroid, PointB=pt_5, Unitize=False)  # -> Vector, Length
move_3 = Move(Geometry=boundary, Motion=vec2pt.Vector)  # -> Geometry, Transform
rotate = Rotate(Geometry=move_3.Geometry, Angle=1.570796327, Plane=PlaneXY(0, 0, 0))  # -> Geometry, Transform

# ----
brep_context = Brep(building)
multiplication = Multiplication(A=panel_5, B=panel_6)
mesh_2 = Mesh(brep_context)
equals = Equality(FirstNumber=number_slider_2, SecondNumber=num_visual_depth)  # -> Equality, Inequality
series_3 = Series(Start="0", Step="1", Count=multiplication)
explode_2 = Explode(Curve=crv_pedestrian_path, Recursive=True)  # -> Segments, Vertices
panel_7 = Panel(equals.Equality)
mjoin = MeshJoin(Meshes=mesh_2)
analyze_resolution = Panel("30")
avr = Average(Input=num_visual_depth)  # -> flatten(ArithmeticMean)
panel_8 = Panel(avr)
item = TreeItem(Tree=num_visual_depth, Path=number_slider, Index=series_3, Wrap=True)
bnd = Bounds(Numbers=avr)
log = Logarithm(Value=item)
bnd_2 = Bounds(Numbers=log)
remap = RemapNumbers(Value=avr, Source=bnd, Target=Domain(0, 1))  # -> simplify(Mapped), Clipped
remap_2 = RemapNumbers(Value=log, Source=bnd_2, Target=Domain(0, 1))  # -> simplify(Mapped), Clipped
panel_9 = Panel(remap.Mapped)
gradient = Gradient(
    LowerLimit=0,
    UpperLimit=1,
    Parameter=remap.Mapped,
    stops=[0: RGB(234, 38, 0), 0.25: RGB(234, 126, 0), 0.5: RGB(254, 244, 84), 0.75: RGB(173, 203, 249), 1: RGB(75, 107, 169)])
gradient_2 = Gradient(
    LowerLimit=0,
    UpperLimit=1,
    Parameter=remap_2.Mapped,
    stops=[0: RGB(234, 38, 0), 0.25: RGB(234, 126, 0), 0.5: RGB(254, 244, 84), 0.75: RGB(173, 203, 249), 1: RGB(75, 107, 169)])
preview_3 = CustomPreview(Geometry=explode_2.Segments, Material=gradient)
graph = QuickGraph(remap.Mapped, SortOrder=0)
preview_4 = CustomPreview(Geometry=boundary, Material=gradient_2)
geo = Geometry(cluster.geo_blocks_4)
srf_analysis_surface = Surface(geo)

# ---- group: WHAT??
explode_3 = Explode(Curve=srf_analysis_surface, Recursive=True)  # -> Segments, Vertices
join_2 = JoinCurves(Curves=explode_3.Segments, Preserve=False)
boundary_2 = BoundarySurfaces(Edges=join_2)

# ----
cluster_3 = Cluster_3(input_surface=boundary_2, subsurface_length=analyze_resolution, num_offset_length=Slider(0, range=0..6))  # -> srf_analysis_surface_4, pt_analysis_point_2
cluster_4 = Cluster_4(input_surface=explode, subsurface_length=analyze_resolution, num_offset_length=Slider(0, range=0..6))  # -> srf_analysis_surface_4, pt_analysis_point_2, vec_normals_of_surfaces_2, srf_horizontal_surface_2
panel_10 = Panel(cluster_3.srf_analysis_surface_4)
evalsrf = EvaluateSurface(Surface=reparameterize(cluster_3.srf_analysis_surface_4), Point="{0.5,0.5,0}")  # -> Point, Normal, UDirection, VDirection, Frame

# ---- group: Building Surface with Sunlightr
occ = Occlusion(Samples=cluster_4.pt_analysis_point_2, Obstructions=mjoin, Rays=sunpath.vectors)  # -> Hits, Occlusion
not = GateNot(A=occ.Hits)
cull = CullPattern(List=cluster_4.vec_normals_of_surfaces_2, CullPattern=not)
cull_2 = CullPattern(List=cluster_4.srf_analysis_surface_4, CullPattern=not)
gradient_3 = Gradient(LowerLimit=0, UpperLimit=1, Parameter=occ.Hits, stops=[0: RGB(255, 255, 255), 1: RGB(0, 0, 0)])
vec_building_surface_normal_vector = Vector(cull)
srf_surface_with_sunlight = Surface(cull_2)
preview_5 = CustomPreview(Geometry=cluster_4.srf_analysis_surface_4, Material=gradient_3)

# ---- group: Ground with Sunlight
occ_2 = Occlusion(Samples=evalsrf.Point, Obstructions=building_ground, Rays=sunpath.vectors)  # -> Hits, simplify(flatten(Occlusion))
not_2 = GateNot(A=occ_2.Hits)
cull_3 = CullPattern(List=cluster_3.srf_analysis_surface_4, CullPattern=not_2)
srf_surface_with_sunlight_2 = Surface(cull_3)
gradient_4 = Gradient(
    LowerLimit=0,
    UpperLimit=1,
    Parameter=occ_2.Hits,
    stops=[0: RGB(234, 38, 0), 0.25: RGB(234, 126, 0), 0.5: RGB(254, 244, 84), 0.75: RGB(173, 203, 249), 1: RGB(75, 107, 169)])
area_3 = Area(Geometry=srf_surface_with_sunlight_2)  # -> Area, Centroid
Z = UnitZ(Factor=1)
addition = Addition(A=area_3.Centroid, B=Z)
vec2pt_2 = Vector2Pt(PointA=area_3.Centroid, PointB=addition, Unitize=False)  # -> Vector, Length
preview_6 = CustomPreview(Geometry=cluster_3.srf_analysis_surface_4, Material=simplify(gradient_4))

# ----
vec_building_surface_normal_vector_2 = Vector(vec_building_surface_normal_vector)
srf_surface_with_sunlight_3 = Surface(srf_surface_with_sunlight)
panel_11 = Panel(not_2)
panel_12 = Panel(srf_surface_with_sunlight_2)
item_2 = ListItem(List=explode_2.Vertices, Index=number_slider, Wrap=True)  # -> Item, Item1
vec2pt_3 = Vector2Pt(PointA=item_2.Item, PointB=item_2.Item1, Unitize=False)  # -> Vector, Length
panel_13 = Panel(vec2pt_2.Vector)
vec_pedestrian_head_direction = Vector(vec2pt_3.Vector)
pi = Pi(Factor=1)
srf_surface_with_sunlight_4 = Surface(flatten([srf_surface_with_sunlight_3, srf_surface_with_sunlight_2]))
division = Division(A=pi, B="3")
sin = Sine(Value=division)
dprod = DotProduct(VectorA=vec_building_surface_normal_vector, VectorB=vec_pedestrian_head_direction, Unitize=False)
larger = LargerThan(FirstNumber=dprod, SecondNumber=sin)  # -> LargerThan, OrEqualTo
not_3 = GateNot(A=larger.OrEqualTo)
panel_14 = Panel(not_3)

# ---- group: Simulation Main
vd_2 = ViewDepth(
    Path=crv_pedestrian_path,
    MaxRayLength=Slider(300, range=0..1000),
    HorizontalViewRes="12",
    VerticalViewRes="15",
    Geometry=srf_surface_with_sunlight_4)
num_visual_depth_2 = Number(vd_2)

# ----
multiplication_2 = Multiplication(A=panel_5, B=panel_6)
series_4 = Series(Start="0", Step="1", Count=multiplication_2)
avr_2 = Average(Input=num_visual_depth_2)
item_3 = TreeItem(Tree=num_visual_depth_2, Path=number_slider, Index=series_4, Wrap=True)
log_2 = Logarithm(Value=item_3)
bnd_3 = Bounds(Numbers=log_2)
x_offset = Slider(88, range=0..1000)
number_slider_4 = Slider(487, range=0..1000)
remap_3 = RemapNumbers(Value=log_2, Source=bnd_3, Target=Domain(0, 1))  # -> simplify(Mapped), Clipped
offset_y_from_path = Panel("50")
line_height = Panel("20")
x_offset_2 = Slider(413, range=0..1000)
bnd_4 = Bounds(Numbers=flatten(avr_2))
gradient_5 = Gradient(LowerLimit=0, UpperLimit=1, Parameter=remap_3.Mapped, stops=[0: RGB(255, 255, 255), 1: RGB(0, 0, 0)])
remap_4 = RemapNumbers(Value=flatten(avr_2), Source=bnd_4, Target=Domain(0, 1))  # -> Mapped, Clipped
line_height_2 = Panel("20")
gradient_6 = Gradient(LowerLimit=0, UpperLimit=1, Parameter=remap_4.Mapped, stops=[0: RGB(255, 255, 255), 1: RGB(0, 0, 0)])
gradient_7 = Gradient(
    LowerLimit=0,
    UpperLimit=1,
    Parameter=remap_2.Mapped,
    stops=[0: RGB(234, 38, 0), 0.25: RGB(234, 126, 0), 0.5: RGB(254, 244, 84), 0.75: RGB(173, 203, 249), 1: RGB(75, 107, 169)])
item_4 = ListItem(List=flatten(avr_2), Index=number_slider, Wrap=True)
item_5 = ListItem(List=avr, Index=number_slider, Wrap=True)
size_adjustment = Panel("0.2")
size_adjustment_2 = Panel("0.2")
pt_6 = ConstructPoint(XCoordinate=x_offset, YCoordinate=number_slider_4, ZCoordinate=0)
pt_7 = ConstructPoint(XCoordinate=x_offset_2, YCoordinate=Slider(487, range=0..1000), ZCoordinate=0)
panel_15 = Panel("20")
concat = Concatenate(FragmentA="Average Reflective Light : ", FragmentB=item_4)
concat_2 = Concatenate(FragmentA="Maxiumum View Depth : ", FragmentB=number_slider_2)
concat_3 = Concatenate(FragmentA="Path : ", FragmentB=number_slider)
concat_4 = Concatenate(FragmentA="Average View Depth : ", FragmentB=item_5)
concat_5 = Concatenate(FragmentA="Maxiumum View Depth : ", FragmentB=number_slider_2)
addition_2 = Addition(A=number_slider_4, B=offset_y_from_path)
addition_3 = Addition(A=addition_2, B=line_height_2)
addition_4 = Addition(A=addition_3, B=line_height_2)
addition_5 = Addition(A=addition_2, B=line_height)
addition_6 = Addition(A=addition_5, B=line_height)
addition_7 = Addition(A=x_offset, B="-40")
addition_8 = Addition(A=x_offset, B="-40")
item_6 = ListItem(List=explode_2.Segments, Index=number_slider, Wrap=True)
pt_8 = ConstructPoint(XCoordinate=x_offset, YCoordinate=addition_7, ZCoordinate=0)
item_7 = ListItem(List=explode_2.Segments, Index=number_slider, Wrap=True)
pt_9 = ConstructPoint(XCoordinate=x_offset_2, YCoordinate=addition_3, ZCoordinate=0)
pt_10 = ConstructPoint(XCoordinate=Slider(205, range=0..1000), YCoordinate=Slider(205, range=0..1000), ZCoordinate=0)
pt_11 = ConstructPoint(XCoordinate=x_offset_2, YCoordinate=addition_4, ZCoordinate=0)
pt_12 = ConstructPoint(XCoordinate=Slider(534, range=0..1000), YCoordinate=Slider(205, range=0..1000), ZCoordinate=0)
pt_13 = ConstructPoint(XCoordinate=x_offset, YCoordinate=addition_2, ZCoordinate=0)
pt_14 = ConstructPoint(XCoordinate=x_offset, YCoordinate=addition_5, ZCoordinate=0)
pt_15 = ConstructPoint(XCoordinate=x_offset, YCoordinate=addition_6, ZCoordinate=0)
pt_16 = ConstructPoint(XCoordinate=x_offset_2, YCoordinate=addition_8, ZCoordinate=0)
crvtoscreen = RenderCurveToScreen(
    Curve=item_6,
    Location=pt_6,
    ScaleFactor=size_adjustment,
    Color=ColourSwatch(SwatchColor=RGB(255, 0, 0)),
    Thickness="6",
    Depth=0.95,
    Fixed=True,
    m_scWithvp=False)
crvtoscreen_2 = RenderCurveToScreen(
    Curve=explode_2.Segments,
    Location=pt_6,
    ScaleFactor=size_adjustment,
    Color=gradient,
    Thickness="3",
    Depth=0.95,
    Fixed=True,
    m_scWithvp=False)
texttoscreen = RenderTextToScreen(Text="View Depth Simulation", Location=pt_8, Size=12, Color=RGB(0, 0, 0), m_scWithvp=False)
texttoscreen_2 = RenderTextToScreen(Text=concat_3, Location=pt_13, Size=12, Color=RGB(0, 0, 0), m_scWithvp=False)
texttoscreen_3 = RenderTextToScreen(Text=concat_4, Location=pt_14, Size=12, Color=RGB(0, 0, 0), m_scWithvp=False)
texttoscreen_4 = RenderTextToScreen(Text=concat_5, Location=pt_15, Size=12, Color=RGB(0, 0, 0), m_scWithvp=False)
crvtoscreen_3 = RenderCurveToScreen(
    Curve=item_7,
    Location=pt_7,
    ScaleFactor=size_adjustment_2,
    Color=ColourSwatch(SwatchColor=RGB(0, 13, 255)),
    Thickness="6",
    Depth=0.95,
    Fixed=True,
    m_scWithvp=False)
crvtoscreen_4 = RenderCurveToScreen(
    Curve=explode_2.Segments,
    Location=pt_7,
    ScaleFactor=size_adjustment,
    Color=gradient_6,
    Thickness="3",
    Depth=0.95,
    Fixed=True,
    m_scWithvp=False)
meshtoscreen = RenderMeshToScreen(
    Mesh=rotate.Geometry,
    Location=pt_12,
    ScaleFactor=Slider(2, range=0..100),
    Color=gradient_5,
    Depth=0.95,
    Fixed=Toggle(True),
    m_scWithvp=False)
meshtoscreen_2 = RenderMeshToScreen(
    Mesh=rotate.Geometry,
    Location=pt_10,
    ScaleFactor=Slider(2, range=0..100),
    Color=gradient_7,
    Depth=0.95,
    Fixed=Toggle(True),
    m_scWithvp=False)
texttoscreen_5 = RenderTextToScreen(Text="Reflective Sunlight", Location=pt_16, Size=12, Color=RGB(0, 0, 0), m_scWithvp=False)
texttoscreen_6 = RenderTextToScreen(Text=concat, Location=pt_9, Size=12, Color=RGB(0, 0, 0), m_scWithvp=False)
texttoscreen_7 = RenderTextToScreen(Text=concat_2, Location=pt_11, Size=12, Color=RGB(0, 0, 0), m_scWithvp=False)

# ==== cluster Cluster
num_medium_density_far_threshold = ClusterInput()
num_high_density_far_threshold = ClusterInput()
int_density_distribution_selection = ClusterInput()
domain_assigning_density = ClusterInput()
num_density_distribution = ClusterInput()
num_street_width = ClusterInput()
gate_street_grip = ClusterInput()
num_avg_far = ClusterInput()
geo_street_2 = ClusterInput()
geo_street_1 = ClusterInput()
gate_density = ClusterInput()
geo_street_3 = ClusterInput()
geo_corner = ClusterInput()
geo_center = ClusterInput()
geo_north = ClusterInput()
geo_site = ClusterInput()
num_medium_density_far_threshold_2 = Number(num_medium_density_far_threshold)
num_high_density_far_threshold_2 = Number(num_high_density_far_threshold)
int_density_distribution_selection_2 = Integer(int_density_distribution_selection)
domain_assigning_density_2 = Domain(domain_assigning_density)
num_density_distribution_2 = Number(num_density_distribution)
num_street_width_2 = Number(num_street_width)
gate_street_grip_2 = Number(gate_street_grip)
num_avg_far_2 = Number(num_avg_far)
geo_street_2_2 = Geometry(geo_street_2)
geo_street_1_2 = Geometry(geo_street_1)
gate_density_2 = Number(gate_density)
geo_street_3_2 = Geometry(geo_street_3)
geo_corner_2 = Geometry(geo_corner)
geo_center_2 = Geometry(geo_center)
geo_north_2 = Geometry(geo_north)
geo_site_2 = Geometry(geo_site)
item = ListItem(List=num_density_distribution_2, Index=int_density_distribution_selection_2, Wrap=True)
boundary = BoundarySurfaces(Edges=geo_site_2)
filter = StreamFilter(Gate=gate_street_grip_2, Stream0=geo_street_3_2, Stream1=geo_street_2_2, Stream2=geo_street_1_2)
filter_2 = StreamFilter(Gate=gate_density_2, Stream0=geo_center_2, Stream1=geo_north_2, Stream2=geo_corner_2)
num_density_distribution_3 = Number(item)
geo_linear_denstiy = Geometry(filter_2)
geo_street_center = Geometry(filter)
margin_for_offset = Panel("35")
ext = ExtendCurve(Curve=geo_street_center, Type=0, Start=margin_for_offset, End=margin_for_offset)
offset = OffsetCurve(Curve=graft(ext), Distance=num_street_width_2, Corners=1)  # -> flatten(Curve)
srfsplit = SurfaceSplit(Surface=boundary, Curves=offset)  # -> simplify(Fragments)
area = Area(Geometry=srfsplit)  # -> Area, Centroid
pull = PullPoint(Point=area.Centroid, Geometry=geo_street_center, ClosestOnly=True)  # -> ClosestPoint, Distance
smaller = SmallerThan(FirstNumber=pull.Distance, SecondNumber="1")  # -> SmallerThan, OrEqualTo
dispatch = Dispatch(List=srfsplit, DispatchPattern=smaller.SmallerThan)  # -> ListA, ListB
geo_blocks = Geometry(dispatch.ListA)
geo_street = Geometry(dispatch.ListB)
domain_assigning_density_order_a_to_b_ma = Domain(domain_assigning_density_2)  # "Domain: Assigning Density (Order A to B matters)"

# ---- group: Define Density by Geometry
explode = Explode(Curve=geo_street, Recursive=True)  # -> Segments, Vertices
pull_2 = PullPoint(Point=simplify(explode.Vertices), Geometry=geo_linear_denstiy, ClosestOnly=True)  # -> ClosestPoint, Distance
reb = RebuildCurve(Curve=explode.Segments, Degree="1", Count=10, Tangents=False)
sort = SortList(Keys=pull_2.Distance)  # -> Keys, ValuesA
join = JoinCurves(Curves=reb, Preserve=False)  # -> simplify(Curves)
item_2 = ListItem(List=sort.Keys, Index="0", Wrap=True)  # -> flatten(Item)
bnd = Bounds(Numbers=item_2)
remap = RemapNumbers(Value=item_2, Source=bnd, Target=domain_assigning_density_order_a_to_b_ma)  # -> simplify(graft(Mapped)), Clipped
parcels = Parcels(Polygons=join, ConnectionDistance=1, StreetOffset=0, PlotWidthThreshold=remap.Mapped, Precision=100)

# ----
geo_streets = Geometry(geo_street)
geo_blocks_2 = Geometry(geo_blocks)
geo_parcels = Geometry(simplify(parcels))
geo_parcels_2 = Geometry(simplify(geo_parcels))

# ---- group: Varyies Degree of Density Variation
num_density_distribution_4 = Number(num_density_distribution_3)
num_avg_far_3 = Number(num_avg_far_2)
addition = Addition(A=num_density_distribution_4, B="1")
subtraction = Subtraction(A="1", B=num_density_distribution_4)
multiplication = Multiplication(A=num_avg_far_3, B=addition)
multiplication_2 = Multiplication(A=num_avg_far_3, B=subtraction)
dom = ConstructDomain(DomainStart=multiplication, DomainEnd=multiplication_2)

# ----
boundary_2 = BoundarySurfaces(Edges=geo_parcels_2)
num_high_density_far_threshold_3 = Number(num_high_density_far_threshold_2)
num_medium_density_far_threshold_3 = Number(num_medium_density_far_threshold_2)
geo_blocks_3 = Geometry(geo_blocks_2)
geo_streets_2 = Geometry(geo_streets)
geo_blocks_4 = ClusterOutput(geo_blocks_3)
geo_streets_3 = ClusterOutput(geo_streets_2)

# ---- group: Calculate Distance to Attractor for Density
explode_2 = Explode(Curve=geo_parcels, Recursive=True)  # -> Segments, Vertices
pull_3 = PullPoint(Point=explode_2.Vertices, Geometry=geo_linear_denstiy, ClosestOnly=True)  # -> ClosestPoint, Distance
sort_2 = SortList(Keys=pull_3.Distance)  # -> Keys, ValuesA

# ---- group: Calculate Distance to Attractor for Density / Choose Closest DIstance
item_3 = ListItem(List=sort_2.Keys, Index="0", Wrap=True)

# ---- group: Calculate Distance to Attractor for Density (continued)
bnd_2 = Bounds(Numbers=flatten(item_3))
remap_2 = RemapNumbers(Value=item_3, Source=bnd_2, Target=dom)  # -> Mapped, Clipped

# ----
num_far = Number(remap_2.Mapped)
path_mapper = PathMapper(num_far, source="{x;y}", target="{x}")
larger = LargerThan(FirstNumber=path_mapper, SecondNumber=num_high_density_far_threshold_3)  # -> LargerThan, OrEqualTo
dispatch_2 = Dispatch(List=boundary_2, DispatchPattern=larger.LargerThan)  # -> HighDensity, ListB
dispatch_3 = Dispatch(List=path_mapper, DispatchPattern=larger.LargerThan)  # -> HighDensityFAR, ListB
smaller_2 = SmallerThan(FirstNumber=dispatch_3.ListB, SecondNumber=num_medium_density_far_threshold_3)  # -> SmallerThan, OrEqualTo
dispatch_4 = Dispatch(List=dispatch_3.ListB, DispatchPattern=smaller_2.SmallerThan)  # -> MediumDensityFAR, LowDensityFAR
dispatch_5 = Dispatch(List=dispatch_2.ListB, DispatchPattern=smaller_2.SmallerThan)  # -> MediumDensity, LowDensity

num_medium_density_far = Number(flatten(dispatch_4.LowDensityFAR))
num_high_density_far = Number(flatten(dispatch_3.HighDensityFAR))
num_low_density_far = Number(flatten(dispatch_4.MediumDensityFAR))

num_low_density_far_2 = ClusterOutput(num_low_density_far)
num_medium_density_far_2 = ClusterOutput(num_medium_density_far)
num_high_density_far_2 = ClusterOutput(num_high_density_far)
bound_low_density = ClusterOutput(dispatch_5.MediumDensity)
bound_high_desity = ClusterOutput(dispatch_2.HighDensity)
bound_medium_density = ClusterOutput(dispatch_5.LowDensity)

# ==== cluster Cluster_2
num_floor_height = ClusterInput()
num_medium_density_far = ClusterInput()
bound_medium_density = ClusterInput()
brep_med = ClusterInput()
brep_high = ClusterInput()
brep_low = ClusterInput()
bound_high_density = ClusterInput()
num_high_density_far = ClusterInput()
bound_low_density = ClusterInput()
num_low_density_far = ClusterInput()
num_floor_height_2 = Number(num_floor_height)
brep_med_2 = Brep(brep_med)
brep_high_2 = Brep(brep_high)
brep_low_2 = Brep(brep_low)
num_floor_height_3 = Number(num_floor_height_2)
sortbytype = SortObjectsByType(RhinoObjects=brep_high_2)  # -> Points, Curves, Surfaces, Breps, Meshes, TextObjects, HatchObjects, LightObjects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
sortbytype_2 = SortObjectsByType(RhinoObjects=brep_low_2)  # -> Points, Curves, Surfaces, Breps, Meshes, TextObjects, HatchObjects, LightObjects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
sortbytype_3 = SortObjectsByType(RhinoObjects=brep_med_2)  # -> Points, Curves, Surfaces, Breps, Meshes, TextObjects, HatchObjects, LightObjects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
bbox = BoundingBox(Content=sortbytype_2.Breps, Plane=PlaneXY(0, 0, 0))  # -> Box, Box_2
bbox_2 = BoundingBox(Content=sortbytype.Breps, Plane=PlaneXY(0, 0, 0))  # -> Box, Box_2
bbox_3 = BoundingBox(Content=sortbytype_3.Breps, Plane=PlaneXY(0, 0, 0))  # -> Box, Box_2
Z = UnitZ(Factor="100")
Z_2 = UnitZ(Factor="100")
Z_3 = UnitZ(Factor="100")
move = Move(Geometry=bound_high_density, Motion=Z)  # -> Geometry, Transform
move_2 = Move(Geometry=bound_low_density, Motion=Z_2)  # -> Geometry, Transform
move_3 = Move(Geometry=bound_medium_density, Motion=Z_3)  # -> Geometry, Transform
blendbox = BlendBox(SurfaceA=bound_high_density, DomainA=bound_high_density, SurfaceB=move.Geometry, DomainB=move.Geometry)
blendbox_2 = BlendBox(SurfaceA=bound_low_density, DomainA=bound_low_density, SurfaceB=move_2.Geometry, DomainB=move_2.Geometry)
blendbox_3 = BlendBox(SurfaceA=bound_medium_density, DomainA=bound_medium_density, SurfaceB=move_3.Geometry, DomainB=move_3.Geometry)
area = Area(Geometry=bound_medium_density)  # -> Area, Centroid
area_2 = Area(Geometry=bound_high_density)  # -> Area, Centroid
morph = BoxMorph(Geometry=sortbytype.Breps, Reference=bbox_2.Box, Target=blendbox)  # -> flatten(Geometry)
morph_2 = BoxMorph(Geometry=sortbytype_2.Breps, Reference=bbox.Box, Target=blendbox_2)  # -> flatten(Geometry)
morph_3 = BoxMorph(Geometry=sortbytype_3.Breps, Reference=bbox_3.Box, Target=blendbox_3)  # -> flatten(Geometry)
area_3 = Area(Geometry=bound_low_density)  # -> Area, Centroid
num_gfa = Number(flatten(area.Area))
num_gfa_2 = Number(flatten(area_2.Area))
num_gfa_3 = Number(flatten(area_3.Area))
volume = Volume(Geometry=morph)  # -> Volume, Centroid
volume_2 = Volume(Geometry=morph_2)  # -> Volume, Centroid
volume_3 = Volume(Geometry=morph_3)  # -> Volume, Centroid
multiplication = Multiplication(A=num_floor_height_3, B=num_gfa)
multiplication_2 = Multiplication(A=num_floor_height_3, B=num_gfa_3)
multiplication_3 = Multiplication(A=num_floor_height_3, B=num_gfa_2)
num_volume_per_floor = Number(multiplication)
ma = MassAddition(Input=graft(volume.Volume))  # -> Result, PartialResults
ma_2 = MassAddition(Input=graft(volume_3.Volume))  # -> Result, PartialResults
ma_3 = MassAddition(Input=graft(volume_2.Volume))  # -> Result, PartialResults
num_volume_per_floor_2 = Number(multiplication_2)
num_volume_per_floor_3 = Number(multiplication_3)
division = Division(A=num_volume_per_floor, B=simplify(flatten(ma_2.Result)))
division_2 = Division(A=num_volume_per_floor_3, B=simplify(flatten(ma.Result)))
division_3 = Division(A=num_volume_per_floor_2, B=simplify(flatten(ma_3.Result)))
multiplication_4 = Multiplication(A=num_medium_density_far, B=division)
multiplication_5 = Multiplication(A=num_high_density_far, B=division_2)
multiplication_6 = Multiplication(A=num_low_density_far, B=division_3)
scale_nu = ScaleNU(Geometry=morph_3, Plane=PlaneXY(0, 0, 0), ScaleX=1, ScaleY=1, ScaleZ=multiplication_4)  # -> Geometry, Transform
scale_nu_2 = ScaleNU(Geometry=morph_2, Plane=PlaneXY(0, 0, 0), ScaleX=1, ScaleY=1, ScaleZ=multiplication_6)  # -> Geometry, Transform
scale_nu_3 = ScaleNU(Geometry=morph, Plane=PlaneXY(0, 0, 0), ScaleX=1, ScaleY=1, ScaleZ=multiplication_5)  # -> Geometry, Transform

brep_medium_far_building = Brep(scale_nu.Geometry)
brep_low_far_building = Brep(scale_nu_2.Geometry)
brep_high_far_building = Brep(scale_nu_3.Geometry)

brep_low_far_building_2 = ClusterOutput(brep_low_far_building)
brep_high_far_building_2 = ClusterOutput(brep_high_far_building)
brep_medium_far_building_2 = ClusterOutput(brep_medium_far_building)

# ==== cluster Cluster_3
num_offset_length = ClusterInput()
input_surface = ClusterInput()
subsurface_length = ClusterInput()
input_surface_2 = Surface(input_surface)
num_offset_length_2 = Number(num_offset_length)
subsurface_length_2 = Integer(subsurface_length)

# ---- group: Extract Analysis Surface
evalsrf = EvaluateSurface(Surface=input_surface_2, Point="{0.5,0.5,0}")  # -> Point, Normal, UDirection, VDirection, Frame
pdecon = Deconstruct(Point=evalsrf.Normal)  # -> XComponent, YComponent, ZComponent
abs = Absolute(Value=pdecon.ZComponent)
smaller = SmallerThan(FirstNumber=abs, SecondNumber=Slider(1, range=0..1))  # -> flatten(SmallerThan), OrEqualTo
dispatch = Dispatch(List=flatten(input_surface_2), DispatchPattern=smaller.SmallerThan)  # -> graft(ListA), graft(ListB)
srf_analysis_surface = Surface(reparameterize(dispatch.ListB))

# ---- group: Divide Surface
dim = Dimensions(Surface=srf_analysis_surface)  # -> UDimension, VDimension
division = Division(A=dim.UDimension, B=subsurface_length_2)
division_2 = Division(A=dim.VDimension, B=subsurface_length_2)
round = Round(Number=division)  # -> Nearest, Floor, Ceiling
round_2 = Round(Number=division_2)  # -> Nearest, Floor, Ceiling
divide = DivideDomain²(Domain=srf_analysis_surface, UCount=round.Nearest, VCount=round_2.Nearest)
subsrf = Isotrim(Surface=srf_analysis_surface, Domain=divide)
srf_analyze_srf = Surface(subsrf)

# ---- group: Extract Info
evalsrf_2 = EvaluateSurface(Surface=reparameterize(srf_analyze_srf), Point="{0.5,0.5,0}")  # -> Point, Normal, UDirection, VDirection, Frame
join = BrepJoin(Breps=flatten(srf_analysis_surface))  # -> Breps, Closed
pull = PullPoint(Point=simplify(evalsrf_2.Point), Geometry=join.Breps, ClosestOnly=True)  # -> ClosestPoint, Distance
int = Integer(pull.Distance)
equals = Equality(FirstNumber=int, SecondNumber="0")  # -> Equality, Inequality
cull = CullPattern(List=simplify(srf_analyze_srf), CullPattern=equals.Equality)
cull_2 = CullPattern(List=simplify(evalsrf_2.Point), CullPattern=equals.Equality)
cull_3 = CullPattern(List=simplify(evalsrf_2.Normal), CullPattern=equals.Equality)
vec_raw_normal_vectors = Vector(cull_3)
srf_analysis_surface_2 = Surface(cull)
pt_centriod_points = Point(cull_2)

# ----
input_surface_3 = Surface(flatten(input_surface_2))

# ---- group: Make Normal Vector Outward
addition = Addition(A=pt_centriod_points, B=vec_raw_normal_vectors)
join_2 = BrepJoin(Breps=input_surface_3)  # -> Breps, Closed
brepinc = PointInBrep(Brep=join_2.Breps, Point=addition, Strict=False)
multiplication = Multiplication(A=brepinc, B="-2")
addition_2 = Addition(A=multiplication, B="1")
multiplication_2 = Multiplication(A=vec_raw_normal_vectors, B=addition_2)
vec_normal_vector = Vector(multiplication_2)
multiplication_3 = Multiplication(A=vec_normal_vector, B=num_offset_length_2)
move = Move(Geometry=simplify(cull_2), Motion=simplify(multiplication_3))  # -> Geometry, Transform

# ----
srf_analysis_surface_3 = Surface(srf_analysis_surface_2)
pt_analysis_point = Point(move.Geometry)
srf_analysis_surface_4 = ClusterOutput(srf_analysis_surface_3)
pt_analysis_point_2 = ClusterOutput(pt_analysis_point)

# ==== cluster Cluster_4
num_offset_length = ClusterInput()
input_surface = ClusterInput()
subsurface_length = ClusterInput()
input_surface_2 = Surface(input_surface)
num_offset_length_2 = Number(num_offset_length)
subsurface_length_2 = Integer(subsurface_length)

# ---- group: Extract Analysis Surface
evalsrf = EvaluateSurface(Surface=input_surface_2, Point="{0.5,0.5,0}")  # -> Point, Normal, UDirection, VDirection, Frame
pdecon = Deconstruct(Point=evalsrf.Normal)  # -> XComponent, YComponent, ZComponent
abs = Absolute(Value=pdecon.ZComponent)
smaller = SmallerThan(FirstNumber=abs, SecondNumber=Slider(1, range=0..1))  # -> flatten(SmallerThan), OrEqualTo
dispatch = Dispatch(List=flatten(input_surface_2), DispatchPattern=smaller.SmallerThan)  # -> graft(ListA), ListB
srf_analysis_surface = Surface(reparameterize(dispatch.ListA))

# ----
join = BrepJoin(Breps=input_surface_2)  # -> flatten(Breps), Closed

# ---- group: Divide Surface
dim = Dimensions(Surface=srf_analysis_surface)  # -> UDimension, VDimension
division = Division(A=dim.UDimension, B=subsurface_length_2)
division_2 = Division(A=dim.VDimension, B=subsurface_length_2)
round = Round(Number=division)  # -> Nearest, Floor, Ceiling
round_2 = Round(Number=division_2)  # -> Nearest, Floor, Ceiling
divide = DivideDomain²(Domain=srf_analysis_surface, UCount=round.Nearest, VCount=round_2.Nearest)
subsrf = Isotrim(Surface=srf_analysis_surface, Domain=divide)
srf_analyze_srf = Surface(subsrf)

# ---- group: Extract Info
evalsrf_2 = EvaluateSurface(Surface=reparameterize(srf_analyze_srf), Point="{0.5,0.5,0}")  # -> Point, Normal, UDirection, VDirection, Frame
join_2 = BrepJoin(Breps=flatten(srf_analysis_surface))  # -> Breps, Closed
pull = PullPoint(Point=simplify(evalsrf_2.Point), Geometry=join_2.Breps, ClosestOnly=True)  # -> ClosestPoint, Distance
int = Integer(pull.Distance)
equals = Equality(FirstNumber=int, SecondNumber="0")  # -> Equality, Inequality
cull = CullPattern(List=simplify(srf_analyze_srf), CullPattern=equals.Equality)
cull_2 = CullPattern(List=simplify(evalsrf_2.Point), CullPattern=equals.Equality)
cull_3 = CullPattern(List=simplify(evalsrf_2.Normal), CullPattern=equals.Equality)
vec_raw_normal_vectors = Vector(cull_3)
srf_analysis_surface_2 = Surface(cull)
pt_centriod_points = Point(cull_2)

# ----
input_surface_3 = Surface(graft(input_surface_2))
panel = Panel(join.Breps)

# ---- group: Make Normal Vector Outward
addition = Addition(A=pt_centriod_points, B=vec_raw_normal_vectors)
brepinc = PointInBrep(Brep=graft(join.Breps), Point=addition, Strict=False)
multiplication = Multiplication(A=brepinc, B="-2")
addition_2 = Addition(A=multiplication, B="1")
multiplication_2 = Multiplication(A=vec_raw_normal_vectors, B=addition_2)
vec_normal_vector = Vector(multiplication_2)
multiplication_3 = Multiplication(A=vec_normal_vector, B=num_offset_length_2)
move = Move(Geometry=simplify(cull_2), Motion=simplify(multiplication_3))  # -> Geometry, Transform

# ----
panel_2 = Panel(addition)
int_2 = Integer(brepinc)
panel_3 = Panel(addition_2)
viewer = ParamViewer(brepinc)
panel_4 = Panel(vec_raw_normal_vectors)
vec_normals_of_surfaces = Vector(vec_normal_vector)
srf_horizontal_surface = Surface(dispatch.ListB)
srf_analysis_surface_3 = Surface(srf_analysis_surface_2)
panel_5 = Panel(vec_normal_vector)
pt_analysis_point = Point(move.Geometry)
srf_analysis_surface_4 = ClusterOutput(srf_analysis_surface_3)
pt_analysis_point_2 = ClusterOutput(pt_analysis_point)
vec_normals_of_surfaces_2 = ClusterOutput(vec_normals_of_surfaces)
srf_horizontal_surface_2 = ClusterOutput(srf_horizontal_surface)
